% Simulink data dictionary cell_balance.sldd

cell_voltage = Simulink.Signal(Dimensions=12, StorageClass="ImportedExtern", DataType="uint16")
cell_balance = Simulink.Signal(Dimensions=12, StorageClass="ExportedGlobal", DataType="uint8")
Offset = Simulink.Parameter(16, StorageClass="ExportedGlobal", DataType="uint8")