% Simulink data dictionary protect.sldd

UV_FLAG = Simulink.Signal(StorageClass="ExportedGlobal", DataType="uint8")
OV_FLAG = Simulink.Signal(StorageClass="ExportedGlobal", DataType="uint8")
cell_voltage = Simulink.Signal(StorageClass="ImportedExtern", DataType="uint16", Dimensions=12)