% Simulink data dictionary Ah_Integrator_Estimator.sldd

Current = Simulink.Signal(StorageClass="ImportedExtern", DataType="int16")
Q_rated = Simulink.Parameter(1200, StorageClass="ExportedGlobal", DataType="uint16")
SOC = Simulink.Signal(StorageClass="ExportedGlobal", DataType="uint16")
InitialSOC = Simulink.Signal(StorageClass="ImportedExtern", DataType="uint16")
eta_coulomb = Simulink.Parameter(0.99, StorageClass="ExportedGlobal", DataType="single")