% Simulink data dictionary state_machine.sldd

BMS_State = Simulink.Signal(StorageClass="ExportedGlobal", DataType="Enum: BMS_State_Enum")
StateRequest = Simulink.Signal(StorageClass="ExportedGlobal", DataType="Enum: SRE")
CriticalFault = Simulink.Signal(StorageClass="ExportedGlobal", DataType="boolean")
Configuration = Simulink.ConfigSet(StartTime="0", StopTime="10", FixedStep="0.001", Solver="FixedStepDiscrete", ProdHWDeviceType="ARM Compatible->ARM Cortex-M", SystemTargetFile="ert.tlc", TargetLang="C")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

SRE = enum(DefaultValue="Standby", StorageType="uint8")  % User State Request
  Standby = 0  % Standby or Inactive Operational State
  Charging = 1  % Charging State
  Driving = 2  % Driving State

BMS_State_Enum = enum(DefaultValue="BMS_Standby", StorageType="uint8")
  BMS_Standby = 0
  BMS_Charging = 1
  BMS_Driving = 2
  BMS_Fault = 3